# Grasshopper definition problem.gh (Grasshopper 1.0.7)
# plug-ins: Kangaroo2 Components

# CollisionMesh
mesh = Mesh([<mesh referenced from the Rhino model> x5])

# ----
# Safety Plane
number_slider = Slider(0.46, range=0..1)
construct_point = ConstructPoint(XCoordinate=0, YCoordinate=0, ZCoordinate=number_slider)
xy_plane = XYPlane(Origin=construct_point)

# ----
# Development Tools
# Reload Python Modules (if Module Code is Changed)
python_module_to_reload = Panel("""compas
compas_fab
roslibpy
integral_timber_joints""")
reload = Button()
py = PythonScript(reload_module_button=reload, module_names=python_module_to_reload)  # inputs module_names: list
# ---------- py: Python ----------
import compas_ghpython
from compas_ghpython import unload_modules
if reload_module_button:
    for module in module_names:
        unload_modules(module)
# ---------- end py ----------

# ---- group: MoveCollisionBoxAlogX
number_slider_2 = Slider(0, range=-0.5..0.5)

# ----
# Check Path and Environment
compas_version = GhPythonScript()  # -> out, compas_version, compas_fab_version, compas_path, compas_fab_path, compas_env_name, python_directory
# ---------- compas_version: Python ----------
__author__ = "leungp"
__version__ = "2020.04.20"

import rhinoscriptsyntax as rs
import compas
import compas_fab
compas_version  = compas.__version__
compas_fab_version = compas_fab.__version__
import os
compas_path = os.path.abspath(compas.__file__)
compas_fab_path = os.path.abspath(compas_fab.__file__)

import compas_bootstrapper
compas_env_name = compas_bootstrapper.ENVIRONMENT_NAME
python_directory = compas_bootstrapper.PYTHON_DIRECTORY
# ---------- end compas_version ----------
compas_environment_name = Panel(compas_version.compas_env_name)
compas_version_2 = Panel(compas_version.compas_version)
compas_fab_version = Panel(compas_version.compas_fab_version)
compas_path = Panel(compas_version.compas_path)
compas_fab_path = Panel(compas_version.compas_fab_path)
python_directory = Panel(compas_version.python_directory)

curve = Curve([<curve referenced from the Rhino model> x2])
collisionprintbed = Mesh(mesh)
X = UnitX(Factor=number_slider_2)

# ----
# Specify Collision Models
panel = Panel("""box_back
box_left
box_right
box_front
box_bottom""")
brep = Brep([<brep referenced from the Rhino model> x5])
mesh_brep = MeshBrep(
    Brep=brep,
    Settings={GridMaxCount=0, GridMinCount=16, JaggedSeams=False, MaxEdgeLength=0, MinEdgeLength=0.0001, MinTolerance=0, Refine=True, RefineAngle=0, RelativeTolerance=0.65, SimplePlanes=True, Tolerance=0})
triangulate = Triangulate(Mesh=mesh_brep)  # -> Mesh, Count

move = Move(Geometry=collisionprintbed, Motion=X)  # -> Geometry, Transform
curve_2 = Curve(curve)
tri = Triangulate(Mesh=move.Geometry)  # -> flatten(Mesh), Count

# ---- group: ScaleCollisionBoxXY
scalexy = Slider(1.5, range=0.5..3)

# ----
load = GhPythonScript(repo_relative_path="tool\lilli902\lilli902.json")  # -> out, load_path, loaded_object
# ---------- load: Python ----------
from Rhino.RhinoDoc import ActiveDoc
from compas.data import json_load
import os
current_doc_path = os.path.split(ActiveDoc.Path)[0]
root_folder = os.path.dirname(os.path.dirname(current_doc_path))
load_path = root_folder + os.path.sep + repo_relative_path
loaded_object = json_load(load_path)
# ---------- end load ----------

# ----
# Load Robot Model / Semantics / Tools
panel_2 = Panel("robot\gofa10\crb15000_10kg_model.json")
xy_plane_2 = XYPlane(Origin=Point(0, 0, 0))
load_2 = GhPythonScript(repo_relative_path="robot\gofa10\crb15000_10kg_semantics.json")  # -> out, load_path, loaded_object; same code as load
load_3 = GhPythonScript(repo_relative_path=panel_2)  # -> out, load_path, loaded_object; same code as load
tool_attachment_frame = Plane(xy_plane_2)
single_tool_robotcell = GhPythonScript(
    robot_model=load_3.loaded_object,
    robot_semantics=load_2.loaded_object,
    tool_model=load.loaded_object,
    touch_link="link_6",
    attachment_frame=tool_attachment_frame,
    rigid_body_ids=panel,
    rigid_bodies=triangulate.Mesh)  # -> out, robot_cell, robot_cell_state; inputs touch_link: list, rigid_body_ids: list, rigid_bodies: list of Mesh
# ---------- single_tool_robotcell: Python ----------
from compas_fab.robots import RobotCell
from compas_fab.robots import RigidBody
from compas_rhino.conversions import plane_to_compas_frame
from compas_rhino.conversions import mesh_to_compas
attachment_frame = plane_to_compas_frame(attachment_frame) if attachment_frame else None

tool_models = {tool_model.name: tool_model}
rigid_body_models = {}
if rigid_body_ids or rigid_bodies:
    assert len(rigid_body_ids) == len(rigid_bodies)
    for id, mesh in zip(rigid_body_ids, rigid_bodies):
        rigid_body = RigidBody.from_mesh(mesh_to_compas(mesh))
        rigid_body_models[id] = rigid_body

robot_cell = RobotCell( robot_model, robot_semantics, tool_models, rigid_body_models)

robot_cell_state = robot_cell.default_cell_state()

robot_cell_state.tool_states[tool_model.name].attached_to_group = robot_cell.main_group_name
robot_cell_state.tool_states[tool_model.name].touch_links = touch_link or []
robot_cell_state.tool_states[tool_model.name].attachment_frame = attachment_frame
# ---------- end single_tool_robotcell ----------

# ----
# Load Planning Result
panel_3 = Panel("path_0.result")
load_4 = GhPythonScript(filename=panel_3, load=Toggle(True))  # -> out, process_path, object
# ---------- load_4: Python ----------
from Rhino.RhinoDoc import ActiveDoc
import os
from compas import json_load
json_location = os.path.split(ActiveDoc.Path)[0]

from npp2.tasks import PrintingProcess

if filename:
    process_path = json_location + os.path.sep + filename
    print(process_path)
    if load:
        object=json_load(process_path)
# ---------- end load_4 ----------
panel_4 = Panel(load_4.process_path)
de_process = GhPythonScript(process=load_4.object)  # -> out, start_state, robotic_movements
# ---------- de_process: Python ----------
robotic_movements = process.get_robotic_movements()

start_state = process.start_state
# ---------- end de_process ----------
movement_trajectory_states = GhPythonScript(start_state=de_process.start_state, movement=de_process.robotic_movements)  # -> out, flatten(states)
# ---------- movement_trajectory_states: Python ----------
states = []
if movement.trajectory:
    for point in movement.trajectory.points:
        state = start_state.copy()
        state.robot_configuration.joint_values = point.joint_values
        states.append(state)
# ---------- end movement_trajectory_states ----------

end_points = EndPoints(Curve=curve_2)  # -> graft(Start), graft(End)
explode = Explode(Curve=curve_2, Recursive=True)  # -> Segments, Vertices
bbox = BoundingBox(Content=tri.Mesh, Plane=PlaneXY(0, 0, 0), UnionBox=True)  # -> Box, Box_2
volume = Volume(Geometry=bbox.Box)  # -> Volume, Centroid
scale_nu = ScaleNU(Geometry=tri.Mesh, Plane=volume.Centroid, ScaleX=scalexy, ScaleY=scalexy, ScaleZ=1)  # -> Geometry, Transform
project = Project(Geometry=end_points.Start, Plane=xy_plane)  # -> Geometry, Transform
# OLD_PathPlanning
project_2 = Project(Geometry=end_points.End, Plane=xy_plane)  # -> Geometry, Transform
split_list = SplitList(List=explode.Vertices, Index=1)  # -> ListA, ListB

# ----
# Playback Slider
number_slider_3 = Slider(1, range=0..1)
list_length = ListLength(List=movement_trajectory_states.states)  # -> expr("x-1", Length)
multiplication = Multiplication(A=list_length, B=number_slider_3)
list_item = ListItem(List=movement_trajectory_states.states, Index=multiplication, Wrap=True)

mesh_2 = Mesh(scale_nu.Geometry)
panel_5 = Panel(project.Geometry)

python_module_to_reload_2 = Panel("npp2")
reload_2 = Button()
py_2 = PythonScript(reload_module_button=reload_2, module_names=python_module_to_reload_2)  # inputs module_names: list; same code as py

construct_domain = ConstructDomain(DomainStart=Slider(20, range=0..100), DomainEnd=Slider(47, range=0..100))

# ----
# Retract End
panel_6 = Panel("-1")
unit_z = UnitZ(Factor=panel_6)
pointaxiswaypoints = GhPythonScript(points=project_2.Geometry, z_axes=unit_z, mode="TOOL")  # -> out, waypoint; inputs points: list of Point3d, z_axes: list
# ---------- pointaxiswaypoints: Python ----------
from compas_fab.robots import PointAxisWaypoints
from compas_rhino.conversions import point_to_compas
from compas_rhino.conversions import vector_to_compas

target_point = [point_to_compas(p) for p in points]
target_z_axis = [vector_to_compas(z) for z in z_axes]
target_points_and_axes = zip(target_point, target_z_axis)
target_mode = mode
waypoint = PointAxisWaypoints(target_points_and_axes, target_mode)
# ---------- end pointaxiswaypoints ----------
cartesian_motion = GhPythonScript(waypoint=pointaxiswaypoints.waypoint, tag="retract", speed_type="40")  # -> out, task
# ---------- cartesian_motion: Python ----------
from npp2.tasks import RoboticLinearMovement

target = waypoint
task = RoboticLinearMovement(target, speed_type=speed_type, tag=tag)
# ---------- end cartesian_motion ----------

z_axisretracval = Slider(0.018, range=0..0.03)

z_axisretracval_2 = Slider(0.05, range=0..0.05)
crvendshorten = Slider(0.006, range=0.001..0.01)

# ----
# Approach Start
unit_z_2 = UnitZ(Factor="-1")
unit_z_3 = UnitZ(Factor="-1")
crv = Curve([<curve referenced from the Rhino model> x2])
# First Point
panel_7 = Panel("TOOL")
z_axisretracval_3 = Slider(0.018, range=0..0.03)
crvendshorten_2 = Slider(0.006, range=0.001..0.01)

# ----
# Specify Start Configuration
number_slider_4 = Slider(0.15, range=-4..4)
ghpython_script = GhPythonScript(
    robot_cell_state=single_tool_robotcell.robot_cell_state,
    value_0=Slider(0, range=-4..4),
    value_1=number_slider_4,
    value_2=Slider(0.3, range=-4..4),
    value_3=Slider(0, range=-4..4),
    value_4=Slider(-0.45, range=-4..4),
    value_5=Slider(0, range=-4..4))  # -> out, configuration, robot_cell_state
# ---------- ghpython_script: Python ----------
from compas.geometry import Frame
__author__ = "leungp"
__version__ = "2024.10.11"
robot_cell_state = robot_cell_state.copy()
configuration = robot_cell_state.robot_configuration
keys = list(configuration.keys())

values = [eval("value_"+str(i)) for i in range (6)]
for key, value in zip(keys, values):
    configuration[key] = value
    print (key, value)
# ---------- end ghpython_script ----------
forward_kinematics = GhPythonScript(robot_cell=single_tool_robotcell.robot_cell, robot_cell_state=ghpython_script.robot_cell_state)  # -> out, pcf, tcf, ocf
# ---------- forward_kinematics: Python ----------
from compas_rhino.conversions import frame_to_rhino

group = group or robot_cell.main_group_name
frame = robot_cell.forward_kinematics_target_frame(robot_cell_state,"ROBOT")
pcf = frame_to_rhino(frame)

if robot_cell_state.get_attached_tool_id(group):
    frame = robot_cell.forward_kinematics_target_frame(robot_cell_state,"TOOL")
    tcf = frame_to_rhino(frame)

if robot_cell_state.get_attached_workpiece_ids(group):
    frame = robot_cell.forward_kinematics_target_frame(robot_cell_state,"WORKPIECE")
    ocf = frame_to_rhino(frame)
# ---------- end forward_kinematics ----------

pointaxiswaypoints_2 = GhPythonScript(points=project.Geometry, z_axes=unit_z_2, mode=panel_7)  # -> out, waypoint; inputs points: list of Point3d, z_axes: list; same code as pointaxiswaypoints
pointaxiswaypoints_3 = GhPythonScript(points=split_list.ListA, z_axes=unit_z_3, mode="TOOL")  # -> out, waypoint; inputs points: list of Point3d, z_axes: list; same code as pointaxiswaypoints

extruderon = GhPythonScript()  # -> out, task
# ---------- extruderon: Python ----------
from npp2.tasks import ExtruderOn

task = ExtruderOn()
# ---------- end extruderon ----------
list_length_2 = ListLength(List=project.Geometry)
duplicate_data = DuplicateData(Data=extruderon.task, Number=list_length_2, Order=True)

printpathgenerator = PrintPathGenerator(crv=crv, x=crvendshorten, F=z_axisretracval_2)

extruderoff = GhPythonScript()  # -> out, task
# ---------- extruderoff: Python ----------
from npp2.tasks import ExtruderOff

task = ExtruderOff()
# ---------- end extruderoff ----------
list_length_3 = ListLength(List=project.Geometry)
duplicate_data_2 = DuplicateData(Data=extruderoff.task, Number=list_length_3, Order=True)

extruderoff_2 = GhPythonScript()  # -> out, task; same code as extruderoff
list_length_4 = ListLength(List=project.Geometry)
duplicate_data_3 = DuplicateData(Data=extruderoff_2.task, Number=list_length_4, Order=True)

crv_2 = Curve([<curve referenced from the Rhino model> x2])
panel_8 = Panel("40")
crv_3 = Curve(crv_2)
crv_4 = Curve(crv_2)
crv_5 = Curve(printpathgenerator)
crv_6 = Curve(<curve referenced from the Rhino model>)
cartesian_motion_2 = GhPythonScript(waypoint=pointaxiswaypoints_2.waypoint, tag="firstmove", speed_type="40")  # -> out, task; same code as cartesian_motion
cartesian_motion_3 = GhPythonScript(waypoint=pointaxiswaypoints_3.waypoint, tag="approach", speed_type="40")  # -> out, task; same code as cartesian_motion
# PrintPathGeneration
printpathdict = GhPythonScript(Crvs=crv_5)  # -> a, KeyPreview; inputs Crvs: list of Curve
# ---------- printpathdict: Python ----------
import ghpythonlib.components as gh
import rhinoscriptsyntax as rg
PrintDict = {}
test = []

class Data:
    pass
    



#PrintPath Dictionary
for i  in range(len(Crvs)):
    key = str("PrintPath" + str(i))
#    print key
#    print Crvs[i]
    PrintDict.update({key: Crvs[i]})

#TransitionPath Dictionary
for i  in range(len(Crvs)-1):
    endPts1= gh.EndPoints(Crvs[i])
    endPts2= gh.EndPoints(Crvs[i+1])
    transition = gh.Line(endPts1.end, endPts2.start)
    key = str("TransPath" + str(i) + "-"+str(i+1))
    PrintDict.update({key: transition})

KeyPreview = PrintDict

a = Data()
a.PrintDict = PrintDict

print a
# ---------- end printpathdict ----------

# ----
# Visualize the Robot Cell
visualization_scale = Slider(1, range=0..2)
visualize_robotcell = GhPythonScript(
    robot_cell=single_tool_robotcell.robot_cell,
    robot_cell_state=list_item,
    draw_collision=Toggle(False),
    draw_visual=Toggle(True),
    native_scale=visualization_scale)  # -> out, meshes; inputs draw_collision: Boolean, draw_visual: Boolean
# ---------- visualize_robotcell: Python ----------
from compas_fab.ghpython import cache_scene_object

model = robot_cell
kwargs = {
'draw_collision': draw_collision,
'draw_visual': draw_visual,
'native_scale': native_scale,
}
scene_object = cache_scene_object(model, kwargs, ghenv.Component, debug=True)

# Update Scene Object with new state
scene_object.update(robot_cell_state)
meshes = scene_object.draw()
# ---------- end visualize_robotcell ----------

python = GhPythonScript(task=cartesian_motion_2.task)  # -> out, a
# ---------- python: Python ----------
a = task

print a
# ---------- end python ----------

# ----
# Visualize the Robot Cell
visualization_scale_2 = Slider(1, range=0..2)
visualize_robotcell_2 = GhPythonScript(
    robot_cell=single_tool_robotcell.robot_cell,
    robot_cell_state=ghpython_script.robot_cell_state,
    draw_collision=Toggle(True),
    draw_visual=Toggle(False),
    native_scale=visualization_scale_2)  # -> out, meshes; inputs draw_collision: Boolean, draw_visual: Boolean; same code as visualize_robotcell

lng = ListLength(List=crv)
multiplication_2 = Multiplication(A=Slider(0, range=0..1), B=lng)
item = ListItem(List=crv, Index=multiplication_2, Wrap=True)

# ----
# Save the Robot Cell
# Clicking save takes a while
save = Button()
python_2 = GhPythonScript(filename="gofa_10_cell_120box.rc", robot_cell=single_tool_robotcell.robot_cell, output=save)  # -> out, json_location
# ---------- python_2: Python ----------
from Rhino.RhinoDoc import ActiveDoc
import os
from compas import json_dump
json_location = os.path.split(ActiveDoc.Path)[0]

if robot_cell:
    robot_cell_path = json_location + os.path.sep + filename

if output:
    if robot_cell:
        with open(robot_cell_path, 'w') as f:
            # Use pretty=True because False will cause be a bug for PyBullet
            json_dump(robot_cell, f, minimal=True, pretty=False)
# ---------- end python_2 ----------

panel_9 = Panel(printpathdict.KeyPreview)
lng_2 = ListLength(List=crv)
cluster = Cluster(C=crv_4, F=Slider(0.09, range=0..1), x=Slider(0.25, range=0..1), L=crv_4)
crv_7 = Curve(cluster)
printpathdict_2 = GhPythonScript(Crvs=crv_3, transCrvs=crv_7)  # -> a, KeyPreview; inputs Crvs: list of Curve, transCrvs: list of Curve
# ---------- printpathdict_2: Python ----------
import ghpythonlib.components as gh
import rhinoscriptsyntax as rg
PrintDict = {}
test = []

class Data:
    pass
    



#PrintPath Dictionary
for i  in range(len(Crvs)):
    key = str("PrintPath" + str(i))
#    print key
#    print Crvs[i]
    PrintDict.update({key: Crvs[i]})

#TransitionPath Dictionary
for i  in range(len(transCrvs)):
    transition = transCrvs[i]
    key = str("TransPath" + str(i) + "-"+str(i+1))
    PrintDict.update({key: transition})

KeyPreview = PrintDict

a = Data()
a.PrintDict = PrintDict

print a
# ---------- end printpathdict_2 ----------

# ---- group: PrintPathSequenceCheck
printpathsequencedict = GhPythonScript(PrintDict=printpathdict_2.a)  # -> Print, pTag, Trans, tTag
# ---------- printpathsequencedict: Python ----------
PrintDict = PrintDict.PrintDict
Print=[]
pTag=[]
tTag=[]
Trans=[]
PrintLen=0
TransLen=0



len = 0
for path in PrintDict:
    if path.startswith('Print'):
        len +=1
        PrintLen=len

len = 0
for path in PrintDict:
    if path.startswith('Trans'):
        len +=1
        TransLen=len

for i in range(PrintLen):
    key = str("PrintPath" + str(i))
    crv = PrintDict[key]
    Print.append(crv)
    pTag.append(str("p" + str(i)))

for i in range(TransLen):
    key = str("TransPath" + str(i) + "-"+str(i+1))
    crv = PrintDict[key]
    Trans.append(crv)
    tTag.append(str("t" + str(i) + "-"+str(i+1)))
# ---------- end printpathsequencedict ----------
curvepoint = PointOnCurve(printpathsequencedict.Print, parameter=0)
tag = TextTag3D(Location=curvepoint, Text=printpathsequencedict.pTag, Size=0.0015, Justification=7)
midpt = CurveMiddle(Curve=printpathsequencedict.Trans)
tag_2 = TextTag3D(Location=midpt, Text=printpathsequencedict.tTag, Size=0.003, Justification=7)

# ----
# PrintTaskGeneration
panel_10 = Panel(printpathdict_2.KeyPreview)

# ---- group: Speed
number_slider_5 = Slider(15, range=0..100)

# ----
item_2 = ListItem(List=crv, Index=Slider(0, range=0..19), Wrap=True)
series = Series(Start=number_slider_5, Step=0, Count=lng_2)
multiplication_3 = Multiplication(A=series, B=2)

start_end_height = Slider(0.05, range=0..0.5)
divisiondist = Slider(0.004, range=0.001..0.01)

taskgenerator_variablespeed = GhPythonScript(
    PrintDict=printpathdict_2.a,
    DivisionDist=divisiondist,
    testInp=item_2,
    StartEndHeight=start_end_height,
    SpeedList=multiplication_3)  # -> Tasks, Print, Trans, PrintPlanesPreview; inputs testInp: Curve, SpeedList: list
# ---------- taskgenerator_variablespeed: Python ----------
from npp2.tasks import *

from npp2.tasks import RoboticFreeMovement
from npp2.tasks import AirAssistOn
from npp2.tasks import AirAssistOff
from npp2.tasks import ExtruderOn
from npp2.tasks import ExtruderOff
import compas.geometry
import ghpythonlib.components as gh
import rhinoscriptsyntax as rs
from compas.geometry import Point
from compas.geometry import Vector


PrintDict = PrintDict.PrintDict
Tasks = []
PrintPlanesPreview=[]
IdleSpeed = 50

test=[]
Print=[]
Trans=[]
PrintLen=0
TransLen=0


def FlatPlaneGen(input, DivisionDist):
    planes = []
    if DivisionDist > 0:
        div = gh.DivideLength(input, DivisionDist)
        pts = div.points
        unitX = gh.UnitX(-1)
        UnitY = gh.UnitY(1)
        planes = gh.ConstructPlane(pts, unitX, UnitY)
        return planes
    else:
        unitX = gh.UnitX(-1)
        UnitY = gh.UnitY(1)
        planes = gh.ConstructPlane(input, unitX, UnitY)
    return planes

def point_to_compas(point):

    return Point(point.X, point.Y, point.Z)


def vector_to_compas(vector):

    return Vector(vector.X, vector.Y, vector.Z)


def plane_to_compas_frame(plane):

    return Frame(
        point_to_compas(plane.Origin),
        vector_to_compas(plane.XAxis),
        vector_to_compas(plane.YAxis),
    )

def GhToRsPlane(gh_plane):
    RsPlanes = []
    len = gh_plane.__len__()
    for i in range(gh_plane.__len__()):
        origin = gh_plane[i].Origin
        x_axis = gh_plane[i].XAxis
        y_axis = gh_plane[i].YAxis
        temp = rs.PlaneFromFrame(origin, x_axis, y_axis)
        RsPlanes.append(temp)
    return RsPlanes

#Non Applied for this script yet
def TiltPlaneGen(curve, DivisionDist):
    planes = []
    div = gh.DivideLength(curve, DivisionDist)
    pts = div.points
    
    unitX = gh.UnitX(-1)
    UnitY = gh.UnitY(1)
    planes = gh.ConstructPlane(pts, unitX, UnitY)
    return planes


def SafePlane(plane, status, StartEndHeight):
    if status == 'Start':
        transfrom = gh.UnitZ(StartEndHeight)
        temp = gh.Move(plane, transfrom)
        startPt = temp.geometry
        line = gh.Line(startPt, plane)
        SafePlane = FlatPlaneGen(line, DivisionDist)
        return SafePlane
    if status == 'End':
        transfrom = gh.UnitZ(StartEndHeight)
        temp = gh.Move(plane, transfrom)
        startPt = temp.geometry
        line = gh.Line(plane, startPt)
        SafePlane = FlatPlaneGen(line, DivisionDist)
        return SafePlane


def TaskGen(target_frame, speed_type, tag):
    tasks = []
    for i in range(target_frame.__len__()):
        m = RoboticLinearMovement()
        frame = plane_to_compas_frame(target_frame[i])
        m.target_frame = frame
        m.speed_type = speed_type
        m.tag = str(tag + str(i) + "/" + str(target_frame.__len__()) + "---" + "Speed_" + str(speed_type))
        print m.tag
        task = m
        tasks.append(task)
    return tasks

len = 0
for path in PrintDict:
    if path.startswith('Print'):
        len +=1
        PrintLen=len

len = 0
for path in PrintDict:
    if path.startswith('Trans'):
        len +=1
        TransLen=len

for i in range(PrintLen):
    key = str("PrintPath" + str(i))
    crv = PrintDict[key]
    Print.append(crv)

for i in range(TransLen):
    key = str("TransPath" + str(i) + "-"+str(i+1))
    crv = PrintDict[key]
    Trans.append(crv)


#Print Start
StartCrvKey = str("PrintPath" + str(0))
StartCrv = PrintDict[StartCrvKey]
pt = gh.EndPoints(StartCrv)
StartCrvStartPt = pt.start
StartPl = FlatPlaneGen(StartCrvStartPt, 0)
PrintStart = SafePlane(StartPl, 'Start', StartEndHeight)
PrintStart = GhToRsPlane(PrintStart)
PrintPlanesPreview.append(PrintStart)
Task_PrintStart = TaskGen(PrintStart, IdleSpeed, "Inserting Printhead-")

Tasks.append(ExtruderOff())
Tasks.append(AirAssistOff()) 
Tasks.append(Task_PrintStart)
Trans.append(PrintStart)

#Print Execution
for i in range(PrintLen):
    Tasks.append(ExtruderOn()) 
    PrintPlanes = []
    key = str("PrintPath" + str(i))
    crv = PrintDict[key]
    PrintPlanes = FlatPlaneGen(crv, DivisionDist)
    PrintPlanes = GhToRsPlane(PrintPlanes)
    status = str("PrintPath" + str(i) + "_PrintingFrame-")
    layerSpeed = SpeedList[i]
    Task_Print = TaskGen(PrintPlanes, layerSpeed, status)
    Tasks.append(Task_Print)
    Tasks.append(ExtruderOff())
    
    Print.append(PrintPlanes)
    PrintPlanesPreview.append(PrintPlanes)
    
    
    if i < TransLen:
        TransPlanes = []
        Tasks.append(ExtruderOff())
        key = str("TransPath" + str(i) + "-"+str(i+1))
        crv = PrintDict[key]
        TransPlanes = FlatPlaneGen(crv, DivisionDist)
        TransPlanes = GhToRsPlane(TransPlanes)
        status = str("TransPath" + str(i) + "_TransFrame-")
        layerSpeed = SpeedList[i]
        Task_Print = TaskGen(TransPlanes, layerSpeed, status)
        Tasks.append(Task_Print)
        Tasks.append(ExtruderOff())
        Trans.append(TransPlanes)
        PrintPlanesPreview.append(TransPlanes)


#Print End
EndIndex = PrintLen -1
EndCrvKey = str("PrintPath" + str(EndIndex))
EndCrv = PrintDict[EndCrvKey]
pt = gh.EndPoints(EndCrv)
EndCrvEndtPt = pt.end
EndPl = FlatPlaneGen(EndCrvEndtPt, 0)
#PrintEnd = SafePlane(EndPl, 'End', StartEndHeight)
#PrintEnd = GhToRsPlane(PrintEnd)
#PrintPlanesPreview.append(PrintEnd)
#Task_PrintEnd = TaskGen(PrintEnd, IdleSpeed, "Retrieving Printhead-")

Tasks.append(ExtruderOff())
Tasks.append(AirAssistOff())
#Tasks.append(Task_PrintEnd)
#Trans.append(PrintEnd)
# ---------- end taskgenerator_variablespeed ----------
panel_11 = Panel(multiplication_3)
python_3 = GhPythonScript(x=taskgenerator_variablespeed.PrintPlanesPreview)  # -> a
# ---------- python_3: Python ----------
a = x
# ---------- end python_3 ----------
python_4 = GhPythonScript(x=taskgenerator_variablespeed.Tasks)  # -> simplify(flatten(a)); same code as python_3
python_5 = GhPythonScript(x=taskgenerator_variablespeed.Print)  # -> a; same code as python_3
python_6 = GhPythonScript(x=taskgenerator_variablespeed.Trans)  # -> a; same code as python_3
geo = Geometry(python_5)
number_slider_6 = Slider(3721, range=0..3721)
geo_2 = Geometry(python_6)
crv_8 = Curve(geo)
series_2 = Series(Start=0, Step=1, Count=Slider(7270, range=0..7270))
save_2 = Button()
save_3 = Button()
# Export/SaveTask/Json
planningpackage = GhPythonScript(
    static_collision_meshes=mesh_2,
    tasks=python_4,
    file_name="290724_density_Lattice_oneside_LightTest_Abiotic_2",
    save=save_2)  # -> out, a; inputs static_collision_meshes: list of Mesh, tasks: list, save: Boolean
# ---------- planningpackage: Python ----------
from npp2.tasks import PlanningProblem
from compas_rhino.conversions import RhinoMesh
pp = PlanningProblem()

# Fill in the planning problem
#pp.robot = robot
pp.start_configuration = start_configuration
pp.tasks = tasks

# Collision Meshes
from compas_fab.robots import CollisionMesh
cms = []
for i, mesh in enumerate(static_collision_meshes):
    cms.append(CollisionMesh(RhinoMesh.from_geometry(mesh).to_compas(), "static_collision_mesh_%i"%(i)))
pp.static_collision_meshes = cms

# Save
from Rhino.RhinoDoc import ActiveDoc
import os
json_path = os.path.split(ActiveDoc.Path)[0] + os.path.sep + "/PathPlanning/"+ file_name +".json"
from compas.data import json_dump
if save:
    json_dump(pp, json_path)
# ---------- end planningpackage ----------
# Test Changing Base Location
# Parallel Gripper - PG500
# Save
# Save
# Load Test
# Load Test
# Test Motion
# Test Motion
# Artist
# Artist
# Test Changing Base Location
# Parallel Gripper - PG1000
# Save
# Load Test
# Artist
# Test Motion
# Save
# Load Test
# Test Motion
# Artist
# Parallel Gripper - PG1500
# Save
# Load Test
# Test Motion
# Artist
problem = GhPythonScript(
    filename="240103_LilliTestV1.process",
    start_robot_cell_state=ghpython_script.robot_cell_state,
    tasks=python_4,
    output=save_3)  # -> out, process_path; inputs tasks: list
# ---------- problem: Python ----------
from Rhino.RhinoDoc import ActiveDoc
import os
from compas import json_dump
json_location = os.path.split(ActiveDoc.Path)[0]

from npp2.tasks import PrintingProcess

if start_robot_cell_state and tasks:
    process_path = json_location + os.path.sep + filename
    print(process_path)
    process = PrintingProcess(start_robot_cell_state, tasks)
    if output:
        with open(process_path, 'w') as f:
            # Use pretty=True because False will cause be a bug for PyBullet
            json_dump(process, f, pretty=False, minimal=True)
# ---------- end problem ----------

# ----
# Print Path
panel_12 = Panel("-1")
unit_z_4 = UnitZ(Factor=panel_12)

pointaxistarget = GhPythonScript(point=split_list.ListB, z_axis=unit_z_4, mode="TOOL")  # -> out, target; inputs point: Point3d
# ---------- pointaxistarget: Python ----------
from compas_fab.robots import PointAxisTarget
from compas_rhino.conversions import point_to_compas
from compas_rhino.conversions import vector_to_compas

target_point = point_to_compas(point)
target_z_axis = vector_to_compas(z_axis) 
target_points_and_axes = zip(target_point, target_z_axis)
target_mode = mode
target = PointAxisTarget(target_point,target_z_axis,target_mode)
# ---------- end pointaxistarget ----------
list_length_5 = ListLength(List=pointaxistarget.target)
range = Range(Domain=construct_domain, Steps=expr("x-1", list_length_5))

pointaxiswaypoints_4 = GhPythonScript(targets=pointaxistarget.target)  # -> out, waypoint; inputs targets: list
# ---------- pointaxiswaypoints_4: Python ----------
from compas_fab.robots import PointAxisWaypoints

target_points_and_axes = []
for target in targets:
    target_points_and_axes.append((target.target_point, target.target_z_axis))
waypoint = PointAxisWaypoints(target_points_and_axes, targets[0].target_mode)
# ---------- end pointaxiswaypoints_4 ----------

integer = Integer(range)
text_join = TextJoin(Text=integer, Join=",")
cartesian_motion_4 = GhPythonScript(waypoint=pointaxiswaypoints_4.waypoint, tag="print", speed_type=text_join)  # -> out, task; same code as cartesian_motion
merge = Merge(
    Data1=simplify(duplicate_data_3),
    Data2=simplify(cartesian_motion_2.task),
    Data3=simplify(cartesian_motion_3.task),
    Data4=simplify(duplicate_data),
    Data5=simplify(cartesian_motion_4.task),
    Data6=simplify(duplicate_data_2),
    Data7=simplify(cartesian_motion.task))  # -> simplify(Result)
param_viewer = ParamViewer(merge)
panel_13 = Panel(text_join)
list_length_6 = ListLength(List=param_viewer)
series_3 = Series(Start=0, Step=1, Count=list_length_6)
concatenate = Concatenate(Fragment_A="path_", Fragment_B=series_3, A=".process")  # -> graft(Result)

# ----
# Save the Problem
save_4 = Button()
problem_2 = GhPythonScript(filename=concatenate, start_robot_cell_state=ghpython_script.robot_cell_state, tasks=merge, output=save_4)  # -> out, process_path; inputs tasks: list; same code as problem

panel_14 = Panel(problem_2.out)

# ---- group: PrintPreview
number_slider_7 = Slider(0.002, range=0.0005..0.002)
geo_3 = Geometry(flatten(python_3))
swatch = ColourSwatch(SwatchColor=RGB(255, 255, 255))  # disabled
clean = CombineClean()  # disabled
preview = CustomPreview(Geometry=clean, Material=swatch)  # disabled

# ----
lng_3 = ListLength(List=geo_3)
subtraction = Subtraction(A=lng_3, B=1)
dom = ConstructDomain(DomainStart=0, DomainEnd=lng_3)
pt = Point(geo_3)
range_2 = Range(Domain=dom, Steps=subtraction)
item_3 = ListItem(List=pt, Index=series_2, Wrap=True)
gradient = Gradient(
    LowerLimit=0,
    UpperLimit=lng_3,
    Parameter=range_2,
    stops=[0.0985: RGB(255, 255, 192), 0.346: RGB(128, 255, 128), 0.608: RGB(0, 0, 255), 0.904: RGB(255, 0, 0)])
pline = PolyLine(Vertices=flatten(item_3), Closed=False)

# ---- group: PrintPreview (continued)
cloud = CloudDisplay(Points=geo_3, Colours=gradient, Size=Slider(0.003, range=0..0.01), SpriteType=0)

# ==== cluster PrintPathGenerator
crv = ClusterInput()
crv_2 = Curve(crv)
bbox = BoundingBox(Content=flatten(crv_2), Plane=PlaneXY(0, 0, 0), UnionBox=True)  # -> Box, Box_2
volume = Volume(Geometry=bbox.Box)  # -> Volume, Centroid
pt = Point(volume.Centroid)
x = ClusterInput()
explode = Explode(Curve=crv_2, Recursive=True)  # -> Segments, Vertices
neg = Negative(Value=x)
ext = ExtendCurve(Curve=crv_2, Type=0, Start=neg, End=neg)
F = ClusterInput()
end = EndPoints(Curve=ext)  # -> Start, End
pt_2 = Point(end.End)
Z = UnitZ(Factor=F)
move = Move(Geometry=pt_2, Motion=Z)  # -> Geometry, Transform
ln = Line(StartPoint=end.End, EndPoint=move.Geometry)
merge = Merge(Data1=simplify(graft(ext)), Data2=simplify(graft(ln)))
join = JoinCurves(Curves=merge, Preserve=False)  # -> flatten(Curves)
C = ClusterOutput(join)

# ==== cluster Cluster
x = ClusterInput()
neg = Negative(Value=x)
C = ClusterInput()
Y = UnitY(Factor=neg)
end = EndPoints(Curve=C)  # -> Start, End
move = Move(Geometry=end.End, Motion=Y)  # -> Geometry, Transform
ln = Line(StartPoint=end.End, EndPoint=move.Geometry)
L = ClusterInput()
end_2 = EndPoints(Curve=ln)  # -> Start, End
F = ClusterInput()
shift = ShiftList(List=L, Shift=1, Wrap=True)
Z = UnitZ(Factor=F)
cull_i = CullIndex(List=shift, Indices=-1, Wrap=True)
move_2 = Move(Geometry=end_2.End, Motion=Z)  # -> Geometry, Transform
end_3 = EndPoints(Curve=cull_i)  # -> Start, End
ln_2 = Line(StartPoint=end_2.End, EndPoint=move_2.Geometry)
end_4 = EndPoints(Curve=ln_2)  # -> Start, End
cull_i_2 = CullIndex(List=end_4.End, Indices=-1, Wrap=True)
ln_3 = Line(StartPoint=cull_i_2, EndPoint=end_3.Start)
merge = Merge(Data1=simplify(graft(ln)), Data2=simplify(graft(ln_2)), Data3=simplify(graft(ln_3)))
join = JoinCurves(Curves=flatten(merge), Preserve=False)
C_2 = ClusterOutput(join)
