# Grasshopper definition BioPrint901.gh (Grasshopper 1.0.7)

# ----
# Development Tools
# Reload Python Modules (if Module Code is Changed)
python_module_to_reload = Panel("""compas
compas_fab
roslibpy
integral_timber_joints""")
reload = Button()
py = PythonScript(reload_module_button=reload, module_names=python_module_to_reload)  # inputs module_names: list
# ---------- py: Python ----------
import compas_ghpython
from compas_ghpython import unload_modules
if reload_module_button:
    for module in module_names:
        unload_modules(module)
# ---------- end py ----------

# ----
# Check Path and Environment
compas_version = GhPythonScript()  # -> out, compas_version, compas_fab_version, compas_path, compas_fab_path, compas_env_name, python_directory
# ---------- compas_version: Python ----------
__author__ = "leungp"
__version__ = "2020.04.20"

import rhinoscriptsyntax as rs
import compas
import compas_fab
compas_version  = compas.__version__
compas_fab_version = compas_fab.__version__
import os
compas_path = os.path.abspath(compas.__file__)
compas_fab_path = os.path.abspath(compas_fab.__file__)

import compas_bootstrapper
compas_env_name = compas_bootstrapper.ENVIRONMENT_NAME
python_directory = compas_bootstrapper.PYTHON_DIRECTORY
# ---------- end compas_version ----------
# Otto's Hand
compas_environment_name = Panel(compas_version.compas_env_name)
compas_version_2 = Panel(compas_version.compas_version)
compas_fab_version = Panel(compas_version.compas_fab_version)
compas_path = Panel(compas_version.compas_path)
compas_fab_path = Panel(compas_version.compas_fab_path)
python_directory = Panel(compas_version.python_directory)

meshes = Mesh(<mesh referenced from the Rhino model>)
frame_curves_y = Curve(<curve referenced from the Rhino model>)
end = EndPoints(Curve=frame_curves_y)  # -> Start, End

# ----
# Test Changing Base Location
number_slider = Slider(0, range=0..300)
pt = ConstructPoint(XCoordinate=Slider(1, range=0..300), YCoordinate=number_slider, ZCoordinate=0)
xy = XYPlane(Origin=pt)
xz = XZPlane(Origin=Point(0, 0, 0))
rotate = Rotate(Geometry=xy, Angle=degrees(Slider(55, range=0..300)), Plane=xz)  # -> Geometry, Transform

ghpython_script = GhPythonScript(robot_relative_path="robot\gofa10\crb15000_10kg_semantics.json")  # -> out, robot_path, robot_model
# ---------- ghpython_script: Python ----------
from Rhino.RhinoDoc import ActiveDoc
import os
current_doc_path = os.path.split(ActiveDoc.Path)[0]
root_folder = os.path.dirname(os.path.dirname(current_doc_path))
robot_path = root_folder + os.path.sep + robot_relative_path
print(robot_path)
from compas.data import json_load
robot_model = json_load(robot_path)
# ---------- end ghpython_script ----------
ghpython_script_2 = GhPythonScript(robot_relative_path="robot\gofa10\crb15000_10kg_model.json")  # -> out, robot_path, robot_model; same code as ghpython_script
ghpython_script_3 = GhPythonScript(Robot_model=ghpython_script_2.robot_model, Robot_semantics=ghpython_script.robot_model)  # -> Out, A
visualize_object = GhPythonScript(object=flatten(ghpython_script_2.robot_model))  # -> out, draw
# ---------- visualize_object: Python ----------
import scriptcontext as sc
from compas.scene import SceneObject
from compas.scene import Scene

from compas_fab.ghpython.components import create_id

# This script will leak memory due to unused and untracked sceneobject in sticky

debug = True
def debug_print(s):
    if debug:
        print(s)

# Create hash (scope limited to this component) for cacheing SceneObject
# The Data.sha256 function includes the guid of the compas object
#object_hash = object.sha256(as_string=True)
# The ID function is much faster than the sha256()
object_hash = str(id(object))
options_hash = vis_options.sha256(True)
# The ghenv.Component has a guid assigned by GH to each component instance
gh_component = ghenv.Component
sticky_id = create_id(gh_component, object_hash +"_"+ options_hash)
debug_print("Cacheing ID: '{}'".format(sticky_id))


# If scene object exist in sticky
scene_object = None
if sc.sticky.has_key(sticky_id):
    scene_object = sc.sticky[sticky_id]
    # Double check if the item is the same
    if scene_object.item is object:
        debug_print("SceneObject '{}' reused for '{}'".format(type(scene_object).__name__, type(object).__name__))

# Create Scene Object
if scene_object is None:
    scene = Scene()
    kwargs = vis_options.__data__
    scene_object = scene.add(object, **kwargs)
    debug_print("SceneObject {} newly created for {}".format(type(scene_object).__name__, type(object).__name__))
    sc.sticky[sticky_id] = scene_object

draw = scene_object.draw(object_state)
# ---------- end visualize_object ----------
panel = Panel(visualize_object.out)

# ----
# Tool Definition - otto1
# Model the tool changer such that the model at the orgin will be attach to the robot flange.
# 
# Tool changer is a subclass of Tool, however only one instance exist in a given Process. Therefor the name and type_name is the same to simplify things.
# Identifyable name for the tool changer
# Tool Coodinate Frame -
# The tool will attach to this point.
# Approach Vector -
# Vector for the Toolchanger (RobotSide) to dock with Clamp/Screwdriver
panel_2 = Panel("BioPrint901")
meshes_2 = Mesh([<mesh referenced from the Rhino model> x3])
frame_curves_x = Curve(<curve referenced from the Rhino model>)

end_2 = EndPoints(Curve=frame_curves_x)  # -> Start, End
pl_3pt = Plane3Pt(PointA=end_2.Start, PointB=end_2.End, PointC=end.End)

pln = Plane(pl_3pt)
create_toolchanger = GhPythonScript(tool_name=panel_2, visual_meshes=meshes, collision_meshes=meshes_2, tool_coordinate_frame=pln)  # -> out, tool_model; inputs visual_meshes: list of Mesh, collision_meshes: list of Mesh, tool_coordinate_frame: Plane
# ---------- create_toolchanger: Python ----------
#from compas_ghpython import unload_modules
#unload_modules("integral_timber_joints")

from compas.datastructures import Mesh

#from compas_rhino.geometry import RhinoPlane, RhinoMesh, RhinoVector
from compas_rhino.conversions import plane_to_compas_frame
from compas_rhino.conversions import mesh_to_compas
from compas_rhino.conversions import vector_to_compas
from compas_robots import ToolModel

tool_coordinate_frame = plane_to_compas_frame(tool_coordinate_frame)
collision_meshes = [mesh_to_compas(m) for m in collision_meshes]
visual_meshes = [mesh_to_compas(m) for m in visual_meshes]


tool_model = ToolModel(visual=None, frame_in_tool0_frame=tool_coordinate_frame, name=tool_name)
tool_model.add_link("tool_body", visual_meshes=visual_meshes, collision_meshes=collision_meshes)
# ---------- end create_toolchanger ----------

# ----
# Save
# Save location next to Rhino File
# Fle name = tool_name.json
auto_path = GhPythonScript(tool_name=panel_2)  # -> json_path
# ---------- auto_path: Python ----------
from Rhino.RhinoDoc import ActiveDoc
import os
json_path = os.path.split(ActiveDoc.Path)[0] + os.path.sep + tool_name +".json"
pickle_path = os.path.split(ActiveDoc.Path)[0] + os.path.sep + tool_name +".pickle"
# ---------- end auto_path ----------
save = Button()
python = GhPythonScript(tool_model=create_toolchanger.tool_model, json_path=auto_path, output=save)  # -> out, json_path, a
# ---------- python: Python ----------
from compas.data import json_dump

if output:
    with open(json_path, 'w') as f:
        json_dump(tool_model, f)
# ---------- end python ----------

deepcopy = GhPythonScript(data_in=create_toolchanger.tool_model)  # -> data_out
# ---------- deepcopy: Python ----------
from copy import deepcopy

data_out = deepcopy(data_in)
# ---------- end deepcopy ----------
panel_3 = Panel(python.out)
robot_artist = GhPythonScript(tool_model=deepcopy, current_frame=rotate.Geometry)  # -> out, visual; inputs current_frame: Plane
# ---------- robot_artist: Python ----------
from compas_ghpython.artists import RobotModelArtist
from compas_rhino.geometry import RhinoPlane
from compas.geometry import Transformation, Frame

# Create a transformation for base location
if current_frame:
    current_cframe = RhinoPlane.from_geometry(current_frame).to_compas_frame()
    tool_model.current_frame = current_cframe

    tool_model.current_transformation = Transformation.from_frame_to_frame(Frame.worldXY(), current_cframe)
#compas_visual_mesh = tool_model.draw_visual()
#print (compas_visual_mesh)

artist = RobotModelArtist(tool_model)
artist.update(())
visual = artist.draw_visual()
# ---------- end robot_artist ----------

# ----
# Load Test
load_tool = GhPythonScript(json_path=python.json_path)  # -> out, tool_model
# ---------- load_tool: Python ----------
from compas.data import DataDecoder, DataEncoder
import json
with open(json_path, 'r') as f:
    tool_model = json.load(f, cls=DataDecoder)
# ---------- end load_tool ----------
python_2 = GhPythonScript(tool_model=load_tool.tool_model)  # -> out
# ---------- python_2: Python ----------
print ('tool_model type:', type(tool_model))
print ('tool_model:', tool_model)
print ('name:', tool_model.name)
print ("Links: ")
for link in tool_model.links:
    print(" - {}".format(link.name))
    print("  ({} Collision Geometry, {} Visual Geometry)".format(len(link.collision),len(link.visual)))
print ("Joints: ")
for joint in tool_model.joints:
    print(" - {}".format(joint.name))
# ---------- end python_2 ----------
# Test Changing Base Location
# Parallel Gripper - PG500
# Save
# Save
# Load Test
# Load Test
# Test Motion
# Test Motion
# Artist
# Artist
# Test Changing Base Location
# Parallel Gripper - PG1000
# Save
# Load Test
# Artist
# Test Motion
# Save
# Load Test
# Test Motion
# Artist
# Parallel Gripper - PG1500
# Save
# Load Test
# Test Motion
# Artist
panel_4 = Panel(python_2)
