# Grasshopper definition lilli902.gh (Grasshopper 1.0.7)

# ----
# Development Tools
# Reload Python Modules (if Module Code is Changed)
python_module_to_reload = Panel("""compas
compas_fab
roslibpy
integral_timber_joints""")
reload = Button()
py = PythonScript(reload_module_button=reload, module_names=python_module_to_reload)  # inputs module_names: list
# ---------- py: Python ----------
import compas_ghpython
from compas_ghpython import unload_modules
if reload_module_button:
    for module in module_names:
        unload_modules(module)
# ---------- end py ----------

# ----
# Check Path and Environment
compas_version = GhPythonScript()  # -> out, compas_version, compas_fab_version, compas_path, compas_fab_path, compas_env_name, python_directory
# ---------- compas_version: Python ----------
__author__ = "leungp"
__version__ = "2020.04.20"

import rhinoscriptsyntax as rs
import compas
import compas_fab
compas_version  = compas.__version__
compas_fab_version = compas_fab.__version__
import os
compas_path = os.path.abspath(compas.__file__)
compas_fab_path = os.path.abspath(compas_fab.__file__)

import compas_bootstrapper
compas_env_name = compas_bootstrapper.ENVIRONMENT_NAME
python_directory = compas_bootstrapper.PYTHON_DIRECTORY
# ---------- end compas_version ----------
# Otto's Hand
compas_environment_name = Panel(compas_version.compas_env_name)
compas_version_2 = Panel(compas_version.compas_version)
compas_fab_version = Panel(compas_version.compas_fab_version)
compas_path = Panel(compas_version.compas_path)
compas_fab_path = Panel(compas_version.compas_fab_path)
python_directory = Panel(compas_version.python_directory)

# ---- group: Lilli
frame_curves_y = Curve(<curve referenced from the Rhino model>)
frame_curves_x = Curve(<curve referenced from the Rhino model>)
end = EndPoints(Curve=frame_curves_x)  # -> Start, End
end_2 = EndPoints(Curve=frame_curves_y)  # -> Start, End
pl_3pt = Plane3Pt(PointA=end.Start, PointB=end.End, PointC=end_2.End)

# ----
# Tool Definition - otto1
# Model the tool changer such that the model at the orgin will be attach to the robot flange.
# 
# Tool changer is a subclass of Tool, however only one instance exist in a given Process. Therefor the name and type_name is the same to simplify things.
# Identifyable name for the tool changer
# Tool Coodinate Frame -
# The tool will attach to this point.
# Approach Vector -
# Vector for the Toolchanger (RobotSide) to dock with Clamp/Screwdriver
panel = Panel("lilli902")
meshes = Mesh(<mesh referenced from the Rhino model>)
meshes_2 = Mesh([<mesh referenced from the Rhino model> x3])
frame_curves_y_2 = Curve(<curve referenced from the Rhino model>)
frame_curves_x_2 = Curve(<curve referenced from the Rhino model>)
end_3 = EndPoints(Curve=frame_curves_x_2)  # -> Start, End
end_4 = EndPoints(Curve=frame_curves_y_2)  # -> Start, End
pl_3pt_2 = Plane3Pt(PointA=end_3.Start, PointB=end_3.End, PointC=end_4.End)
pln = Plane(pl_3pt)
create_single_body_tool = GhPythonScript(tool_name=panel, visual_meshes=meshes, collision_meshes=meshes_2, tool_coordinate_frame=pln)  # -> out, tool_model; inputs visual_meshes: list of Mesh, collision_meshes: list of Mesh, tool_coordinate_frame: Plane
# ---------- create_single_body_tool: Python ----------
#from compas_ghpython import unload_modules
#unload_modules("integral_timber_joints")

from compas.datastructures import Mesh

#from compas_rhino.geometry import RhinoPlane, RhinoMesh, RhinoVector
from compas_rhino.conversions import plane_to_compas_frame
from compas_rhino.conversions import mesh_to_compas
from compas_rhino.conversions import vector_to_compas
from compas_robots import ToolModel

tool_coordinate_frame = plane_to_compas_frame(tool_coordinate_frame)
collision_meshes = [mesh_to_compas(m) for m in collision_meshes]
visual_meshes = [mesh_to_compas(m) for m in visual_meshes]


tool_model = ToolModel(visual=None, frame_in_tool0_frame=tool_coordinate_frame, name=tool_name)
tool_model.add_link("tool_body", visual_meshes=visual_meshes, collision_meshes=collision_meshes)
# ---------- end create_single_body_tool ----------

pt = ConstructPoint(XCoordinate="0.376456", YCoordinate="0.001006", ZCoordinate="0.122267")

# ----
# Save Tool Model
# Save location next to Rhino File
# Fle name = tool_name.json
auto_path = GhPythonScript(tool_name=panel)  # -> json_path
# ---------- auto_path: Python ----------
from Rhino.RhinoDoc import ActiveDoc
import os
json_path = os.path.split(ActiveDoc.Path)[0] + os.path.sep + tool_name +".json"
pickle_path = os.path.split(ActiveDoc.Path)[0] + os.path.sep + tool_name +".pickle"
# ---------- end auto_path ----------
save = Button()
python = GhPythonScript(tool_model=create_single_body_tool.tool_model, json_path=auto_path, output=save)  # -> out, json_path, a
# ---------- python: Python ----------
from compas.data import json_dump

if output:
    with open(json_path, 'w') as f:
        json_dump(tool_model, f)
# ---------- end python ----------
panel_2 = Panel(python.out)

# ----
# Load Robot Model and Test Tool Attachment
panel_3 = Panel("robot\gofa10\crb15000_10kg_model.json")
load = GhPythonScript(repo_relative_path="robot\gofa10\crb15000_10kg_semantics.json")  # -> out, load_path, loaded_object
# ---------- load: Python ----------
from Rhino.RhinoDoc import ActiveDoc
from compas.data import json_load
import os
current_doc_path = os.path.split(ActiveDoc.Path)[0]
root_folder = os.path.dirname(os.path.dirname(current_doc_path))
load_path = root_folder + os.path.sep + repo_relative_path
loaded_object = json_load(load_path)
# ---------- end load ----------
load_2 = GhPythonScript(repo_relative_path=panel_3)  # -> out, load_path, loaded_object; same code as load
xy_plane = XYPlane(Origin=Point(0, 0, 0))
single_tool_robotcell = GhPythonScript(
    robot_model=load_2.loaded_object,
    robot_semantics=load.loaded_object,
    tool_model=create_single_body_tool.tool_model,
    touch_link="link_6",
    attachment_frame=xy_plane)  # -> out, robot_cell, robot_cell_state
# ---------- single_tool_robotcell: Python ----------
from compas_fab.robots import RobotCell
tool_models = {tool_model.name: tool_model}
robot_cell = RobotCell(robot_model, robot_semantics, tool_models)
robot_cell_state = robot_cell.default_cell_state()

robot_cell_state.tool_states[tool_model.name] .attached_to_group = robot_cell.main_group_name
# ---------- end single_tool_robotcell ----------

# ----
# Test deserialize the Tool Model
load_tool = GhPythonScript(json_path=python.json_path)  # -> out, tool_model
# ---------- load_tool: Python ----------
from compas.data import DataDecoder, DataEncoder
import json
with open(json_path, 'r') as f:
    tool_model = json.load(f, cls=DataDecoder)
# ---------- end load_tool ----------
python_2 = GhPythonScript(tool_model=load_tool.tool_model)  # -> out
# ---------- python_2: Python ----------
print ('tool_model type:', type(tool_model))
print ('tool_model:', tool_model)
print ('name:', tool_model.name)
print ("Links: ")
for link in tool_model.links:
    print(" - {}".format(link.name))
    print("  ({} Collision Geometry, {} Visual Geometry)".format(len(link.collision),len(link.visual)))
print ("Joints: ")
for joint in tool_model.joints:
    print(" - {}".format(joint.name))
# ---------- end python_2 ----------
panel_4 = Panel(python_2)

# ----
# Specify Preview Configuration
number_slider = Slider(0, range=-4..4)
ghpython_script = GhPythonScript(
    robot_cell_state=single_tool_robotcell.robot_cell_state,
    value_0=number_slider,
    value_1=Slider(0, range=-4..4),
    value_2=Slider(0, range=-4..4),
    value_3=Slider(0, range=-4..4),
    value_4=Slider(0, range=-4..4),
    value_5=Slider(0, range=-4..4))  # -> out, configuration, robot_cell_state
# ---------- ghpython_script: Python ----------
from compas.geometry import Frame
__author__ = "leungp"
__version__ = "2024.10.11"
robot_cell_state = robot_cell_state.copy()
configuration = robot_cell_state.robot_configuration
keys = list(configuration.keys())

values = [eval("value_"+str(i)) for i in range (6)]
for key, value in zip(keys, values):
    configuration[key] = value
    print (key, value)
# ---------- end ghpython_script ----------
forward_kinematics = GhPythonScript(robot_cell=single_tool_robotcell.robot_cell, robot_cell_state=ghpython_script.robot_cell_state)  # -> out, pcf, tcf, ocf
# ---------- forward_kinematics: Python ----------
from compas_rhino.conversions import frame_to_rhino

group = group or robot_cell.main_group_name
frame = robot_cell.forward_kinematics_target_frame(robot_cell_state,"ROBOT")
pcf = frame_to_rhino(frame)

if robot_cell_state.get_attached_tool_id(group):
    frame = robot_cell.forward_kinematics_target_frame(robot_cell_state,"TOOL")
    tcf = frame_to_rhino(frame)

if robot_cell_state.get_attached_workpiece_ids(group):
    frame = robot_cell.forward_kinematics_target_frame(robot_cell_state,"WORKPIECE")
    ocf = frame_to_rhino(frame)
# ---------- end forward_kinematics ----------

# ----
# Visualize the Tool Coordinate Frame
boolean_toggle = BooleanToggle(False)
rigidbody_axis_marker = GhPythonScript()  # -> out, marker_rb
# ---------- rigidbody_axis_marker: Python ----------
from compas_fab.robots import RigidBodyLibrary

marker_rb = RigidBodyLibrary.target_marker(0.5)
# ---------- end rigidbody_axis_marker ----------
visualize_rigidbody = GhPythonScript(
    rigid_body=rigidbody_axis_marker.marker_rb,
    base_frame=forward_kinematics.tcf,
    draw_collision=boolean_toggle,
    draw_visual=Toggle(True),
    native_scale=1)  # -> out, meshes; inputs base_frame: Plane, draw_visual: Boolean
# ---------- visualize_rigidbody: Python ----------
from compas_fab.ghpython import cache_scene_object
from compas_fab.robots import RigidBodyState
from compas.geometry import Frame
from compas_rhino.conversions import plane_to_compas_frame

base_frame = plane_to_compas_frame(base_frame) if base_frame else None

kwargs = {
'draw_collision': draw_collision,
'draw_visual': draw_visual,
'native_scale': native_scale,
}


rigid_body_state = RigidBodyState(base_frame or Frame.worldXY())

    
scene_object = cache_scene_object(rigid_body, kwargs, ghenv.Component, debug=True)

# Update Scene Object with new state
scene_object.update(rigid_body_state)
meshes = scene_object.draw()
# ---------- end visualize_rigidbody ----------

# ----
# Visualize the Robot Cell
visualization_scale = Slider(1, range=0..2)
visualize_robotcell = GhPythonScript(
    robot_cell=single_tool_robotcell.robot_cell,
    robot_cell_state=ghpython_script.robot_cell_state,
    draw_collision=Toggle(False),
    draw_visual=Toggle(True),
    native_scale=visualization_scale)  # -> out, meshes; inputs draw_collision: Boolean, draw_visual: Boolean
# ---------- visualize_robotcell: Python ----------
from compas_fab.ghpython import cache_scene_object

model = robot_cell
kwargs = {
'draw_collision': draw_collision,
'draw_visual': draw_visual,
'native_scale': native_scale,
}
scene_object = cache_scene_object(model, kwargs, ghenv.Component, debug=True)

# Update Scene Object with new state
scene_object.update(robot_cell_state)
meshes = scene_object.draw()
# ---------- end visualize_robotcell ----------

visualization_scale_2 = Slider(1, range=0..2)  # disabled
boolean_toggle_2 = BooleanToggle(False)  # disabled
boolean_toggle_3 = BooleanToggle(True)  # disabled
# Test Motion
# Test Motion
# Artist
# Artist
# Test Changing Base Location
# Parallel Gripper - PG1000
# Save
# Load Test
# Artist
# Test Motion
# Save
# Load Test
# Test Motion
# Artist
# Parallel Gripper - PG1500
# Save
# Load Test
# Test Motion
# Artist
visualize_robotmodel = GhPythonScript(
    robot_model=load_2.loaded_object,
    configuration=ghpython_script.configuration,
    draw_collision=boolean_toggle_3,
    draw_visual=boolean_toggle_2,
    native_scale=visualization_scale_2)  # -> out, meshes; inputs base_frame: Plane, draw_collision: Boolean, draw_visual: Boolean; disabled
# ---------- visualize_robotmodel: Python ----------
from compas_fab.ghpython import cache_scene_object
from compas_fab.ghpython import RobotModelObject
from compas_rhino.conversions import plane_to_compas_frame

base_frame = plane_to_compas_frame(base_frame) if base_frame else None

kwargs = {
'draw_collision': draw_collision,
'draw_visual': draw_visual,
'native_scale': native_scale,
}
scene_object = cache_scene_object(robot_model, kwargs, ghenv.Component, RobotModelObject, debug=True)

# Update Scene Object with new state
scene_object.update(configuration, base_frame)
meshes = scene_object.draw()
# ---------- end visualize_robotmodel ----------

boolean_toggle_4 = BooleanToggle(True)  # disabled
boolean_toggle_5 = BooleanToggle(True)  # disabled
# Test Changing Base Location
# Parallel Gripper - PG500
# Save
# Save
# Load Test
# Load Test
visualize_toolmodel = GhPythonScript(
    tool_model=create_single_body_tool.tool_model,
    draw_collision=boolean_toggle_4,
    draw_visual=boolean_toggle_5,
    native_scale=1)  # -> out, meshes; inputs base_frame: Plane, draw_collision: Boolean, draw_visual: Boolean; disabled
# ---------- visualize_toolmodel: Python ----------
from compas_fab.ghpython import cache_scene_object
from compas_fab.ghpython import RobotModelObject
from compas_rhino.conversions import plane_to_compas_frame

base_frame = plane_to_compas_frame(base_frame) if base_frame else None

kwargs = {
'draw_collision': draw_collision,
'draw_visual': draw_visual,
'native_scale': native_scale,
}
scene_object = cache_scene_object(tool_model, kwargs, ghenv.Component, RobotModelObject, debug=True)

# Update Scene Object with new state
scene_object.update(configuration, base_frame)
meshes = scene_object.draw()
# ---------- end visualize_toolmodel ----------
